# Grasshopper definition Kangaroo_Refined_Mapped_Seed.gh (Grasshopper 1.0.8)
# Kangaroo Refined: host-derived scaled seed, same solver and growth settings. Native execution unverified.

seed_scale_0_90_90_of_form = Slider(0.5, range=0.5..0.98)
smooth_curve = Slider(4, range=0..10)
srf = Surface(<surface referenced from the Rhino model>)
crv = Curve(srf)
# HOST SEED | START HERE: HOST-DERIVED STARTING CURVE
# Target 3D form -> smaller outline -> original growth chain.
# Seed scale 0.90 = 90%; try 0.85-0.95.
# Open patches: scale boundary, then return it to the surface.
# Seamed lofts: inset a rounded perimeter in surface coordinates.
# Pause > edit form/scale > RESET > RUN.
# The form, scale and seed update together; no hand-drawn seed.
# Existing 1500 segments and all growth goals are retained.
# Right-click HOST-DERIVED SEED curve > Preview to inspect.
# Native Rhino execution remains unverified.
seed_from_host_form = PythonScript(Host=srf, Scale=seed_scale_0_90_90_of_form)  # -> out, Seed, Report; inputs Host: list
# ---------- seed_from_host_form: Python ----------
"""Host-derived closed seed; IronPython 2.7 / RhinoCommon.
Open patch: scale its outer boundary in 3D, then return sample points to host.
Seamed single-face loft: inset a rounded UV perimeter to avoid tracing the seam twice.
Only creates the starting curve. No simulation or solver feedback here.
"""
import math
import Rhino.Geometry as rg
from Grasshopper.Kernel import GH_RuntimeMessageLevel

def unwrap(x):
    return x.Value if hasattr(x, 'Value') else x

def rounded_perimeter(scale, steps=32):
    lo = (1.0-scale)*0.5
    hi = 1.0-lo
    r = scale*0.06
    # Four counter-clockwise quarter circles; consecutive arcs joined by sides.
    centres = [(hi-r,hi-r,0.0), (lo+r,hi-r,0.5*math.pi),
               (lo+r,lo+r,math.pi), (hi-r,lo+r,1.5*math.pi)]
    points = []
    for index, (cx,cy,start) in enumerate(centres):
        for j in range(steps+1):
            a = start + 0.5*math.pi*j/steps
            points.append((cx+r*math.cos(a),cy+r*math.sin(a)))
        nx,ny,na = centres[(index+1)%4]
        end = points[-1]
        target = (nx+r*math.cos(na),ny+r*math.sin(na))
        for j in range(1,steps):
            t = float(j)/steps
            points.append((end[0]*(1-t)+target[0]*t,end[1]*(1-t)+target[1]*t))
    return points

Seed = None
Report = 'Connect the target form.'
try:
    hosts = [unwrap(x) for x in (Host or []) if unwrap(x) is not None]
    if len(hosts) != 1:
        raise ValueError('Supply exactly one connected, single-face surface/Brep.')
    host = hosts[0]
    if isinstance(host, rg.Brep):
        brep = host
    elif isinstance(host, rg.Surface):
        brep = host.ToBrep()
    else:
        raise ValueError('Host must be a surface or single-face Brep, not a mesh.')
    if brep is None or not brep.IsValid or brep.Faces.Count != 1:
        raise ValueError('Use one valid surface face; joined multi-face forms are outside this seed method.')
    face = brep.Faces[0]
    if any(loop.LoopType == rg.BrepLoopType.Inner for loop in face.Loops):
        raise ValueError('Hosts with holes are outside this single closed-seed method.')
    if any(face.IsSingular(i) for i in range(4)):
        raise ValueError('Surface has a collapsed edge/pole. Use a nonsingular surface patch.')
    scale = float(Scale if Scale is not None else 0.90)
    if math.isnan(scale) or math.isinf(scale) or not 0.50 <= scale <= 0.98:
        raise ValueError('Seed scale must be between 0.50 and 0.98.')
    box = brep.GetBoundingBox(True)
    tol = max(box.Diagonal.Length*1e-8,1e-8)
    periodic = face.IsClosed(0) or face.IsClosed(1)
    if face.IsClosed(0) and face.IsClosed(1):
        raise ValueError('A doubly closed host has no suitable single perimeter. Use an open patch.')
    points = []
    max_pull = 0.0
    if periodic:
        du,dv = face.Domain(0),face.Domain(1)
        for u,v in rounded_perimeter(scale):
            a,b = du.ParameterAt(u),dv.ParameterAt(v)
            if face.IsPointOnFace(a,b) == rg.PointFaceRelation.Exterior:
                raise ValueError('The inset perimeter crosses a trimmed-out region. Use an untrimmed patch.')
            points.append(face.PointAt(a,b))
        method = 'Seamed host: rounded, scaled UV perimeter mapped onto the form.'
        note = 'Scale is in surface coordinates, not a uniform 3D offset. A gap is left beside the seam.'
    else:
        loop = face.OuterLoop
        boundary = loop.To3dCurve() if loop is not None else None
        if boundary is None or not boundary.IsValid or not boundary.IsClosed:
            raise ValueError('The host has no valid closed outer boundary.')
        outline = boundary.DuplicateCurve()
        if not outline.Transform(rg.Transform.Scale(box.Center,scale)):
            raise ValueError('Could not scale the host boundary.')
        ts = list(outline.DivideByCount(512,False) or [])
        ts.insert(0,outline.Domain.T0)
        for t in ts:
            p = outline.PointAt(t)
            ok,u,v = face.ClosestPoint(p)
            if not ok or face.IsPointOnFace(u,v) == rg.PointFaceRelation.Exterior:
                raise ValueError('Scaled outline falls outside the trimmed host. Use a simpler patch or a scale closer to 1.')
            q = face.PointAt(u,v)
            max_pull = max(max_pull,p.DistanceTo(q))
            points.append(q)
        method = 'Outer boundary scaled about form bounding-box centre, then sampled back onto the host.'
        note = 'Projection keeps the seed on the form; spacing to its edges is not a constant offset.'
    clean = []
    for p in points:
        if not p.IsValid:
            raise ValueError('The host produced an invalid seed point.')
        if not clean or p.DistanceTo(clean[-1]) > tol:
            clean.append(p)
    if len(clean)>1 and clean[-1].DistanceTo(clean[0])<=tol:
        clean.pop()
    if len(clean)<12:
        raise ValueError('Seed collapsed after scaling/projection; choose a different scale or host.')
    clean.append(clean[0])
    candidate = rg.PolylineCurve(clean)
    if not candidate.IsValid or not candidate.IsClosed or candidate.GetLength()<=tol:
        raise ValueError('Could not create one valid closed seed.')
    events = rg.Intersect.Intersection.CurveSelf(candidate,tol)
    if events is not None and events.Count>0:
        raise ValueError('Scaled seed intersects itself. Use a simpler host or a scale closer to 1.')
    Seed = candidate
    Report = ('HOST-DERIVED SEED\nScale: {0:.0f}%\n{1}\n{2}\nSeed length: {3:.3f} model units\nBoundary samples: {4}\nMaximum pull-back distance: {5:.3f}\nPause > change form/scale > RESET > RUN.\nOne closed 3D curve feeds the original Divide/Line/Kangaroo chain.\nSeed points lie on the host; polyline chords are approximations.\nWider initial reach is not a guarantee of final coverage.').format(scale*100,method,note,Seed.GetLength(),len(clean)-1,max_pull)
except Exception as exc:
    Seed = None
    Report = 'SEED ERROR: ' + str(exc)
    ghenv.Component.AddRuntimeMessage(GH_RuntimeMessageLevel.Error,Report)
# ---------- end seed_from_host_form ----------
host_seed_status = Panel(seed_from_host_form.Report)
reb = RebuildCurve(Curve=seed_from_host_form.Seed, Degree="3", Count=smooth_curve, Tangents=False)
map_rebuilt_seed_to_form = PythonScript(Host=srf, CurveIn=reb)  # -> out, Seed, Report; inputs Host: list
# ---------- map_rebuilt_seed_to_form: Python ----------
"""Pull the rebuilt seed onto the host BEFORE division and growth.
Rebuild controls remain upstream. Pulling after rebuilding corrects its drift.
Reset Kangaroo after editing the host, seed scale or Smooth Curve slider.
"""
import Rhino
import Rhino.Geometry as rg
from Grasshopper.Kernel import GH_RuntimeMessageLevel

def unwrap(value):
    return value.Value if hasattr(value, 'Value') else value

Seed = None
Report = ''
try:
    hosts = [unwrap(x) for x in (Host or []) if unwrap(x) is not None]
    curve = unwrap(CurveIn)
    if len(hosts) != 1 or not isinstance(curve, rg.Curve):
        raise ValueError('Connect one host and the rebuilt seed curve.')
    host = hosts[0]
    brep = host if isinstance(host, rg.Brep) else host.ToBrep()
    if brep is None or not brep.IsValid or brep.Faces.Count != 1:
        raise ValueError('The seed requires one valid surface face.')
    if not curve.IsValid or not curve.IsClosed:
        raise ValueError('The rebuilt seed must be a valid closed curve.')
    doc = Rhino.RhinoDoc.ActiveDoc
    tolerance = doc.ModelAbsoluteTolerance if doc else max(brep.GetBoundingBox(True).Diagonal.Length * 1e-6, 1e-6)
    pulled = list(curve.PullToBrepFace(brep.Faces[0], tolerance) or [])
    if not pulled:
        raise ValueError('Pull to surface failed. Increase rebuild point count or adjust seed scale.')
    joined = list(rg.Curve.JoinCurves(pulled, tolerance) or [])
    if len(joined) != 1 or not joined[0].IsValid or not joined[0].IsClosed:
        raise ValueError('Pull did not produce one closed seed. Increase rebuild point count or adjust seed scale.')
    Seed = joined[0]
    Report = 'Rebuilt seed pulled onto the host surface before Divide Curve and Kangaroo. RESET after edits.'
except Exception as exc:
    Seed = None
    Report = 'SEED MAPPING: ' + str(exc)
    ghenv.Component.AddRuntimeMessage(GH_RuntimeMessageLevel.Error, Report)
# ---------- end map_rebuilt_seed_to_form ----------

# ---- group: 02 DENSITY INPUTS
attractor_points_optional = Point(<point referenced from the Rhino model>)
# 02 LOCAL DENSITY: DENSITY CONTROLS
# SHOW FORM density paints the full constraint form.
# Blue = open / grey = baseline / orange = dense.
# SHOW curve assignments overlays initial segment values.
# Positive attractor bias: tighter near points / curves.
# Negative bias: more open near them.
# Reach is a fraction of the FULL FORM bounding diagonal.
# Gradient + packs toward high X/Y/Z; - reverses it.
# Right-click optional point / curve parameters to set them.
# Form preview is spatial; growth assignments still travel
# with the starting segments. Pause > Reset > Run.
attractor_curves_optional = Curve(<curve referenced from the Rhino model>)
rest_length_model_units = Slider(10, range=0.1..10)
collision_radius_model_units = Slider(1, range=1..3)
loop_size_contrast = Slider(1.5, range=0..1.5)
spacing_contrast = Slider(1, range=0..1.5)
open_background_away_from_attractors = Slider(0.5, range=0..1)
local_packing_expansion = Slider(0.5, range=0..0.5)
# 05 FORM BUILDER: FORM BUILDER
# Original loft, profile, scale and twist construction retained.
# The loft supplies both the solver mesh and the new seed.
# Changing the form updates the host-derived seed.
# Pause > change form > RESET > RUN.
# Use one nonsingular surface face. Holes and multi-face hosts
# are rejected with a seed error instead of a guessed loop.
show_initial_spatial_field = BooleanToggle(False)
attractor_reach_form_size = Slider(0.21, range=0.01..2)
attractors_open_dense = Slider(1, range=-1..1)
gradient_reverse_forward = Slider(1, range=-1..1)
gradient_axis_0_x_1_y_2_z = Slider(2, range=0..2)
field_smoothing_passes = Slider(1, range=0..30)
density_contrast = Slider(2, range=1..4)
density_blend_0_original = Slider(0.65, range=0..1)
show_initial_assignments = BooleanToggle(False)

# ---- group: 01 START / PAUSE / RESET
# READ FIRST: START HERE | HOST-DERIVED SEED
# 1. Seed is now generated from the target form at 90% scale.
# 2. RUN=True to grow; False to pause. Opens paused.
# 3. Pause > edit > RESET > RUN after changing form or scale.
# 4. Final smooth curve is the live preview. Pipe stays disabled.
# Original solver, 1500 segments and goal settings retained.
# The old planar mapping is bypassed; seed is already in 3D.
mapped_rebuilt_seed = Curve(map_rebuilt_seed_to_form.Seed)
seed_segments_base_1500 = Slider(1500, range=100..5000)

# ---- group: 01 HOST-DERIVED SEED / 3D SEGMENTS
divide = DivideCurve(Curve=mapped_rebuilt_seed, Count=seed_segments_base_1500, Kinks=False)  # -> Points, Tangents, Parameters
old_mapping_surface_unused = Surface(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)
shift = ShiftList(List=divide.Points, Shift=1, Wrap=True)
ln = Line(StartPoint=divide.Points, EndPoint=shift)
old_planar_mapping_bypassed = MapToSurface(Curve=ln, Source=old_mapping_surface_unused, Target=srf)  # disabled
initial_3d_segments = Line(ln)
end = EndPoints(Curve=ln)  # -> Start, End
constraint_mesh = MeshBrep(
    Brep=srf,
    Settings={GridMaxCount=0, GridMinCount=16, JaggedSeams=False, MaxEdgeLength=0, MinEdgeLength=0.0001, MinTolerance=0, Refine=True, RefineAngle=0, RelativeTolerance=0.65, SimplePlanes=True, Tolerance=0})

# ---- group: 04 SOLVER CONTROLS
reset_after_edits = Button()
run_growth = BooleanToggle(False)
momentum_retention = Slider(0.6, range=0..1)
bend_strength_broad_curves = Slider(3000, range=100..10000)
iterations_per_update = Slider(30, range=1..30)
expansion_strength_base_10 = Slider(10, range=0.1..30)
collision_strength_base_500 = Slider(200, range=100..3000)

# ----
# CHECK / SAVE HELP: Pause RUN before checking or saving.
# Empty folder saves in DG_Runs beside this GH file.
# Each SAVE creates a new folder; no overwrites.
# Contains geometry.3dm, run.json, curve_samples.csv.
# Save a matching copy of the GH file with each final run.
# Report stays at the last check until clicked again.
# No tests run automatically while growing.
panel = Panel("2")
check_paused_curve = Button()
save_run_snapshot = Button()
# SMOOTHNESS / LIMITS: CONTROL WITHOUT REBUILDING
# Keep seed segments at 1500 for the supplied look.
# Changing point count also changes total target curve length.
# For less aggressive expansion: lower Expansion strength.
# For less overshoot: lower Momentum retention.
# For broad folds: increase Bend strength gradually.
# Collision strength is now a slider; base value stays 500.
# Lower iterations/update improves response, not step size.
# The smoothed NURBS can deviate from the collision lines.
# CHECK samples bends and distance to the solver mesh.
# No overlap-free or full-coverage guarantee.
# Pause > edit > RESET > RUN.
export_folder_empty_beside_gh = Panel("")

# ---- group: 06 OPTIONAL RENDER - disabled
# 06 OUTPUT: OUTPUT
# Keep Pipe disabled while growing. Bake the final curve
# and thicken the baked copy in Rhino only when needed.
# CHECK / SAVE RUN is downstream and paused-only.
# It never changes Kangaroo or the final curve.
# SAVE RUN records a snapshot, not a live frame sequence.
pipe = Pipe(Radius=1, Caps=0)  # disabled
demesh = DeconstructMesh(Mesh=pipe)  # -> Vertices, Faces, Colours, Normals; disabled
conmesh = ConstructMesh(Vertices=demesh.Vertices, Faces=demesh.Faces)  # disabled
swatch = ColourSwatch(SwatchColor=RGB(31, 207, 204))  # disabled
preview = CustomPreview(Geometry=conmesh, Material=swatch)  # disabled

# ---- group: 03 ORIGINAL KANGAROO GROWTH
shift_2 = ShiftList(List=initial_3d_segments, Shift=1, Wrap=True)
panel_2 = Panel("""Bend strength
now adjustable""")
collision_strength = Panel("""Collision
slider below""")
panel_3 = Panel("""Expansion
slider below""")
stay_on_form = OnMesh(Points=end.End, Mesh=constraint_mesh, Strength="1000")

# ---- group: 02 DENSITY FIELD / DIAGNOSTICS
density_field = PythonScript(
    Segments=flatten(initial_3d_segments),
    Attractors=flatten(attractor_points_optional),
    GuideCurves=flatten(attractor_curves_optional),
    BaseRadius=collision_radius_model_units,
    BaseLength=rest_length_model_units,
    Blend=density_blend_0_original,
    Contrast=density_contrast,
    Reach=attractor_reach_form_size,
    AttractorBias=attractors_open_dense,
    GradientBias=gradient_reverse_forward,
    Axis=gradient_axis_0_x_1_y_2_z,
    GrowthBoost=local_packing_expansion,
    SmoothPasses=field_smoothing_passes,
    ShowField=show_initial_spatial_field,
    ConstraintMeshes=flatten(constraint_mesh),
    ShowLines=show_initial_assignments,
    LoopContrast=loop_size_contrast,
    SpacingContrast=spacing_contrast,
    BackgroundOpen=open_background_away_from_attractors,
    BaseBend=bend_strength_broad_curves,
    ShiftedSegments=flatten(shift_2))  # -> out, Radii, Lengths, Density, PreviewLines, Colours, Report, FormMesh, BendStrengths; inputs Segments: list, Attractors: list, GuideCurves: list, ConstraintMeshes: list, ShiftedSegments: list
#   port Segments: Initial mapped lines in their existing cyclic order.
#   port Attractors: Optional Rhino points. Set one or multiple points near the initial 3D curve.
#   port GuideCurves: Optional Rhino curves. Density follows distance to these curves.
#   port BaseRadius: Original collision radius in model units.
#   port BaseLength: Original spring rest length in model units.
#   port Blend: Density blend (0 = original)
#   port Contrast: Density contrast
#   port Reach: Attractor reach / form size
#   port AttractorBias: Attractors: open (-) / dense (+)
#   port GradientBias: Gradient: reverse (-) / forward (+)
#   port Axis: Gradient axis: 0 X / 1 Y / 2 Z
#   port GrowthBoost: Extra local growth (optional)
#   port SmoothPasses: Field smoothing passes
#   port ShowField: Preview initial segments coloured by assigned density.
#   port ConstraintMeshes: Full constraint meshes for field extent and surface colour preview.
#   port ShowLines: Optional colour preview of initial curve assignments.
#   port Radii: Per-segment collision radii.
#   port Lengths: Per-segment spring rest lengths.
#   port Density: Assigned density multipliers; 1 is original.
#   port PreviewLines: Initial segments, only when ShowField is on.
#   port Colours: Blue=open, grey=baseline, orange=dense.
#   port Report: Control ranges and guidance.
#   port FormMesh: Vertex-coloured full constraint mesh; preview only, physics mesh unchanged.
#   port BendStrengths: One bounded stiffness per existing Angle goal; softer dense, stiffer open.
# ---------- density_field: Python ----------
"""Local spacing for the EXISTING Kangaroo definition (IronPython 2.7 / Rhino 7-8).

The original mapped segments remain the particles and springs. This component
supplies local goals and a full-form coloured mesh preview.
Reach and gradient extents are based on the complete constraint mesh.
Fields are sampled on the INITIAL mapped geometry. Their values travel with
those segments during relaxation; this is not a live world-space field.

Blend=0 reproduces the original scalar radius and rest length exactly.
Positive AttractorBias packs near points/curves; negative values open that area.
Positive GradientBias packs toward the high end of Axis (0=X, 1=Y, 2=Z).
No direct attraction force is applied, so curves are not pulled into sharp tips.
"""
import math
import Rhino.Geometry as rg
from System.Drawing import Color


def clamp(x, a, b):
    return max(a, min(b, x))


def number(x, default, lo, hi):
    try:
        v = float(x)
        if math.isnan(v) or math.isinf(v):
            return default
        return clamp(v, lo, hi)
    except (TypeError, ValueError):
        return default


def unwrap(x):
    # No Type Hint returns native geometry. Also accept GH_Goo if supplied.
    return x.Value if hasattr(x, 'Value') else x


def point(x):
    x = unwrap(x)
    if isinstance(x, rg.Point):
        x = x.Location
    return x if isinstance(x, rg.Point3d) and x.IsValid else None


def segment(x):
    x = unwrap(x)
    if isinstance(x, rg.Line):
        return x
    if isinstance(x, rg.Curve):
        return rg.Line(x.PointAtStart, x.PointAtEnd)
    return None


def smoothstep(t):
    t = clamp(t, 0.0, 1.0)
    return t * t * (3.0 - 2.0 * t)


Radii, Lengths, Density, PreviewLines, Colours = [], [], [], [], []
BendStrengths = []
FormMesh = None
Report = 'Connect mapped segments.'
base_radius = number(BaseRadius, 1.1, 0.000001, 1e9)
base_length = number(BaseLength, 10.0, 0.000001, 1e9)
blend = number(Blend, 1.0, 0.0, 1.0)
contrast = number(Contrast, 2.0, 1.0, 4.0)
reach = number(Reach, 0.35, 0.01, 2.0)
attr_bias = number(AttractorBias, 1.0, -1.0, 1.0)
grad_bias = number(GradientBias, 0.0, -1.0, 1.0)
axis = int(number(Axis, 2, 0, 2))
boost = number(GrowthBoost, 0.0, 0.0, 0.5)
passes = int(number(SmoothPasses, 6, 0, 30))
base_bend = number(BaseBend, 1500.0, 1.0, 1e6)
loop_contrast = number(LoopContrast, 1.0, 0.0, 1.5)
spacing_contrast = number(SpacingContrast, 1.0, 0.0, 1.5)
background = number(BackgroundOpen, 0.5, 0.0, 1.0)
raw = list(Segments or [])
lines = [segment(x) for x in raw]
# Do not silently drop items: that would misalign the collider radii.
if any(x is None or not x.IsValid or x.Length <= 1e-9 for x in lines):
    raise ValueError('Mapped segments contain invalid or zero-length lines. Check the closed seed and mapping surface.')

meshes = [unwrap(m) for m in (ConstraintMeshes or [])]
meshes = [m for m in meshes if isinstance(m, rg.Mesh) and m.IsValid]
form = rg.Mesh()
for m in meshes:
    form.Append(m)

if lines or meshes:
    pts = [x.PointAt(0.5) for x in lines]
    attractors = [point(x) for x in (Attractors or [])]
    attractors = [x for x in attractors if x is not None]
    guides = [unwrap(x) for x in (GuideCurves or [])]
    guides = [x for x in guides if isinstance(x, rg.Curve) and x.IsValid]
    box = form.GetBoundingBox(True) if meshes else rg.BoundingBox(pts)
    diag = max(box.Diagonal.Length, 1e-9)
    radius = max(reach * diag, 1e-9)
    low = (box.Min.X, box.Min.Y, box.Min.Z)[axis]
    high = (box.Max.X, box.Max.Y, box.Max.Z)[axis]
    span = high - low
    def field_at(p):
        coord = (p.X, p.Y, p.Z)[axis]
        distances = [p.DistanceTo(a) for a in attractors]
        for curve in guides:
            ok, t = curve.ClosestPoint(p)
            if ok:
                distances.append(p.DistanceTo(curve.PointAt(t)))
        # Nearest attractor wins. Adding more points cannot blow up the field.
        influence = 0.0
        if distances:
            influence = 1.0 - smoothstep(min(distances) / radius)
        # Smooth bounded axis gradient; zero for a flat/degenerate axis.
        g = 0.0 if span < diag * 1e-9 else 2.0 * smoothstep((coord - low) / span) - 1.0
        # With attractors, actively open the distant region instead of leaving it neutral.
        # No attractors means no background bias. Negative attractor bias reverses both.
        a = influence - background * (1.0 - influence) if (attractors or guides) else 0.0
        return clamp(attr_bias * a + grad_bias * g, -1.0, 1.0)
    f = [field_at(p) for p in pts]
    # Cyclic smoothing respects the closed curve seam. Values remain bounded.
    n = len(f)
    for unused in range(passes):
        f = [0.25 * f[(i - 1) % n] + 0.5 * f[i] + 0.25 * f[(i + 1) % n] for i in range(n)]
    Density = [contrast ** (blend * v) for v in f]
    # Radius controls the room taken by a strand, independently of curvature.
    Radii = [base_radius * clamp(d ** (-spacing_contrast), 0.3, 3.0) for d in Density]
    # Bounded expansion: more curve length where denser packing is intended.
    Lengths = [base_length * clamp(d ** boost, 0.65, 1.5) for d in Density]
    # Use the ACTUAL shifted-line input of the original Angle component.
    # This stays aligned with its goals without assuming Shift List direction.
    # Use both segment assignments to avoid a stiffness jump at a field boundary.
    # Lower stiffness permits smaller folds; higher stiffness resists tight turns.
    # This is a shape bias, not an exact loop-diameter constraint.
    paired = [segment(x) for x in (ShiftedSegments or [])]
    if n and (len(paired) != n or any(x is None or not x.IsValid for x in paired)):
        raise ValueError('ShiftedSegments must match the original Angle goal line list.')
    pf = [field_at(x.PointAt(0.5)) for x in paired] if n else []
    for unused in range(passes):
        pf = [0.25 * pf[(i-1) % n] + 0.5 * pf[i] + 0.25 * pf[(i+1) % n] for i in range(n)]
    pd = [contrast ** (blend * v) for v in pf]
    joint_density = [(Density[i] * pd[i]) ** 0.5 for i in range(n)]
    BendStrengths = [base_bend * clamp(d ** (-2.0 * loop_contrast), 0.12, 6.0) for d in joint_density]
    def colour(v):
        # Fixed scale: blue=0.25x, grey=1x, orange=4x. Contrast affects colour.
        t = clamp(0.5 + 0.5 * blend * v * math.log(contrast) / math.log(4.0), 0.0, 1.0)
        a, b, u = ((40, 115, 190), (190, 195, 200), t * 2.0) if t <= 0.5 else ((190, 195, 200), (235, 110, 40), (t - 0.5) * 2.0)
        return Color.FromArgb(*[int(a[j] + u * (b[j] - a[j])) for j in range(3)])

    if bool(ShowLines):
        PreviewLines = lines
        Colours = [colour(v) for v in f]

    if bool(ShowField) and meshes:
        # Refine a COPY of the constraint mesh, not the physics mesh.
        # Linear triangle subdivision leaves the displayed constraint shape unchanged.
        display = form.DuplicateMesh()
        display.Faces.ConvertQuadsToTriangles()
        rounds = 0
        while rounds < 2 and display.Faces.Count * 4 <= 4000:
            refined = rg.Mesh()
            for v in display.Vertices:
                refined.Vertices.Add(v.X, v.Y, v.Z)
            edge_midpoints = {}
            def midpoint(i, j):
                key = (min(i, j), max(i, j))
                if key not in edge_midpoints:
                    a, b = display.Vertices[i], display.Vertices[j]
                    edge_midpoints[key] = refined.Vertices.Add((a.X+b.X)*0.5, (a.Y+b.Y)*0.5, (a.Z+b.Z)*0.5)
                return edge_midpoints[key]
            for face in display.Faces:
                a, b, c = face.A, face.B, face.C
                ab, bc, ca = midpoint(a,b), midpoint(b,c), midpoint(c,a)
                refined.Faces.AddFace(a,ab,ca)
                refined.Faces.AddFace(ab,b,bc)
                refined.Faces.AddFace(ca,bc,c)
                refined.Faces.AddFace(ab,bc,ca)
            display = refined
            rounds += 1
        display.VertexColors.Clear()
        for v in display.Vertices:
            display.VertexColors.Add(colour(field_at(rg.Point3d(v.X,v.Y,v.Z))))
        display.Normals.ComputeNormals()
        display.Compact()
        FormMesh = display
    notes = []
    if not attractors and not guides:
        notes.append('No attractors set: gradient/uniform field only.')
    if span < diag * 1e-9 and abs(grad_bias) > 0:
        notes.append('Selected gradient axis is flat: choose another axis.')
    if lines and max(x.Length for x in lines) > base_length:
        notes.append('Some starting segments exceed rest length; they initially contract.')
    Report = ('Segments: {0}\nDensity multiplier: {1:.3f} to {2:.3f}\nCollision radius: {3:.3f} to {4:.3f}\nRest length: {5:.3f} to {6:.3f}\nAttractor reach: {7:.3f} model units\nPoint / curve attractors: {8} / {9}\n\nBlue = open | grey = baseline | orange = dense.\nField sampled on initial 3D segments; travels with the curve.\nPause > change controls > Reset > Run.\n{10}').format(n, min(Density or [1.0]), max(Density or [1.0]), min(Radii or [base_radius]), max(Radii or [base_radius]), min(Lengths or [base_length]), max(Lengths or [base_length]), radius, len(attractors), len(guides), '\n'.join(notes))

    Report += '\nField extent: ' + ('full constraint form' if meshes else 'initial curve (no form supplied)')
    Report += '\nSurface colours show the spatial field before cyclic segment smoothing.'
    if FormMesh is not None:
        Report += '\nPreview mesh: {0} vertices, {1} faces'.format(FormMesh.Vertices.Count, FormMesh.Faces.Count)

    Report += '\nBend strength: {0:.1f} to {1:.1f}'.format(min(BendStrengths or [base_bend]), max(BendStrengths or [base_bend]))
    Report += '\nOrange: softer bending, closer spacing, more expansion.\nBlue: stiffer bending, wider spacing, less expansion.'
    if Density and max(Density) / min(Density) < 1.15:
        Report += '\nLOW CONTRAST ON SEED: move attractors nearer the starting curve or increase field contrast.'

    Report += '\nPRESERVED BASE: density travels with segments, not live spatial control.'
    if n:
        initial_total = sum(x.Length for x in lines)
        target_total = sum(Lengths)
        Report += '\nInitial / target total length: {0:.2f} / {1:.2f} model units'.format(initial_total, target_total)
        Report += '\nTarget/initial length ratio: {0:.2f}'.format(target_total / max(initial_total, 1e-9))
        if target_total <= initial_total:
            Report += '\nNO NET EXPANSION: target length does not exceed seed length.'
        if n > 2000:
            Report += '\nHIGH POINT COUNT: more solver work; point count also changes total target length.'
    Report += '\nA settled solver does not prove coverage. No automatic coverage claim.'
# ---------- end density_field ----------
form_field_preview = PythonScript(Mesh=density_field.FormMesh)  # -> out, Form
#   port Mesh: Coloured constraint-form mesh.
#   port Form: Vertex-coloured full constraint mesh; preview only, physics mesh unchanged.
# ---------- form_field_preview: Python ----------
"""Display the mesh vertex colours directly; no material override."""
Form = Mesh
# ---------- end form_field_preview ----------
curve_assignment_colours = CustomPreview(Geometry=density_field.PreviewLines, Material=density_field.Colours)
field_status = Panel(density_field.Report)

# ---- group: 03 ORIGINAL KANGAROO GROWTH (continued)
expansion_springs = LengthLine(Line=initial_3d_segments, Length=density_field.Lengths, Strength=expansion_strength_base_10)
smooth_bending = Angle(LineA=initial_3d_segments, LineB=shift_2, RestAngle="0", Strength=density_field.BendStrengths)
local_spacing = Collider(Objects=initial_3d_segments, Radii=density_field.Radii, Strength=collision_strength_base_500)

# ---- group: 04 RELAX / SMOOTH OUTPUT
bouncysolver = BouncySolver(
    GoalObjects=flatten([stay_on_form, expansion_springs, local_spacing, smooth_bending]),
    Reset=reset_after_edits,
    Threshold=1e-15,
    Tolerance=0.0001,
    Damping=momentum_retention,
    Iterations=iterations_per_update,
    On=run_growth)  # -> I, V, O
final_smooth_closed_curve = NurbsCurve(Vertices=bouncysolver.V, Degree=3, Periodic=invert(False))  # -> Curve, Length, Domain

# ----
pipe_2 = Pipe(Curve=final_smooth_closed_curve.Curve, Radius=panel, Caps=0, FitRail=False)
paused_check_save = PythonScript(
    Curve=final_smooth_closed_curve.Curve,
    Meshes=constraint_mesh,
    Hosts=srf,
    Segments=initial_3d_segments,
    Run=run_growth,
    Check=check_paused_curve,
    Save=save_run_snapshot,
    Folder=export_folder_empty_beside_gh,
    FieldReport=density_field.Report,
    Attractors=attractor_points_optional,
    Guides=attractor_curves_optional)  # -> out, Report, SavedPath; inputs Meshes: list, Hosts: list, Segments: list, Attractors: list, Guides: list
# ---------- paused_check_save: Python ----------
"""Downstream, button-triggered checks/export. No feedback to Kangaroo.
IronPython 2.7 compatible. Geometry checks are sampled, not certification.
"""
import os
import json
import math
import datetime
import uuid
import Rhino
import Rhino.Geometry as rg
import scriptcontext as sc

def unwrap(x):
    return x.Value if hasattr(x, 'Value') else x

key = 'DG_MINIMAL_SNAPSHOT_' + str(ghenv.Component.InstanceGuid)
state = sc.sticky.get(key, {'report': 'Pause RUN, then click CHECK or SAVE RUN.', 'path': '', 'check': False, 'save': False})
check_now, save_now = bool(Check), bool(Save)
trigger = (check_now and not state['check']) or (save_now and not state['save'])
state['check'], state['save'] = check_now, save_now
if trigger:
    if bool(Run):
        state['report'] = 'Pause RUN first. No check or export was performed.'
    else:
        try:
            curve = unwrap(Curve)
            meshes = [unwrap(x) for x in (Meshes or [])]
            meshes = [x for x in meshes if isinstance(x, rg.Mesh) and x.IsValid]
            if not isinstance(curve, rg.Curve) or not curve.IsValid:
                raise ValueError('No valid final curve. Reset and run the solver first.')
            count = 1000
            ts = list(curve.DivideByCount(count, True) or [])
            if len(ts) < 2:
                raise ValueError('Final curve could not be sampled.')
            pts = [curve.PointAt(t) for t in ts]
            bends = [curve.CurvatureAt(t).Length for t in ts]
            finite_bends = [x for x in bends if x > 1e-12 and not math.isnan(x) and not math.isinf(x)]
            deviations = []
            for p in pts:
                if meshes:
                    deviations.append(min(p.DistanceTo(m.ClosestPoint(p)) for m in meshes))
            metrics = {
                'method': 'Final NURBS sampled at 1000 equal arc-length intervals; not an exact extremum or clearance test.',
                'curve_length': curve.GetLength(),
                'closed': bool(curve.IsClosed),
                'valid': bool(curve.IsValid),
                'sample_count': len(pts),
                'sampled_min_bend_radius': 1.0 / max(finite_bends) if finite_bends else None,
                'sampled_max_distance_to_solver_mesh': max(deviations) if deviations else None,
                'overlap_check': 'NOT PERFORMED',
                'coverage_check': 'NOT PERFORMED',
                'units': str(Rhino.RhinoDoc.ActiveDoc.ModelUnitSystem),
            }
            settings = []
            document = ghenv.Component.OnPingDocument()
            for obj in document.Objects:
                kind = obj.GetType().Name
                row = {'id': str(obj.InstanceGuid), 'name': str(obj.NickName), 'type': kind}
                if kind == 'GH_NumberSlider':
                    row['value'] = float(obj.CurrentValue)
                elif kind == 'GH_BooleanToggle':
                    row['value'] = bool(obj.Value)
                elif kind == 'GH_Panel' and obj.SourceCount == 0:
                    row['value'] = str(obj.UserText)
                else:
                    continue
                settings.append(row)
            summary = 'PAUSED CHECK\nLength: {0:.3f} model units\nClosed: {1}\nSampled min bend radius: {2}\nSampled max mesh deviation: {3}\n1000 intervals; sampled estimates only.\nOverlap / coverage: NOT CHECKED.\nChecks never modify the curve.'.format(metrics['curve_length'], metrics['closed'], metrics['sampled_min_bend_radius'], metrics['sampled_max_distance_to_solver_mesh'])
            if save_now:
                folder = str(Folder or '').strip()
                if not folder:
                    docpath = str(document.FilePath or '')
                    if not docpath:
                        raise ValueError('Save this GH file to disk first, or set an export folder.')
                    folder = os.path.join(os.path.dirname(docpath), 'DG_Runs')
                if not os.path.isabs(folder):
                    raise ValueError('Export folder must be an absolute path, or left empty.')
                stamp = datetime.datetime.utcnow().strftime('%Y%m%dT%H%M%SZ')
                runpath = os.path.join(folder, 'run_' + stamp + '_' + uuid.uuid4().hex[:8])
                os.makedirs(runpath)
                model = Rhino.FileIO.File3dm()
                model.Settings.ModelUnitSystem = Rhino.RhinoDoc.ActiveDoc.ModelUnitSystem
                model.Settings.ModelAbsoluteTolerance = Rhino.RhinoDoc.ActiveDoc.ModelAbsoluteTolerance
                def attrs(name):
                    a = Rhino.DocObjects.ObjectAttributes()
                    a.Name = name
                    return a
                model.Objects.AddCurve(curve, attrs('FINAL_CURVE'))
                for i, m in enumerate(meshes):
                    model.Objects.AddMesh(m, attrs('SOLVER_MESH_' + str(i)))
                for i, x in enumerate(Hosts or []):
                    x = unwrap(x)
                    if isinstance(x, rg.Brep):
                        model.Objects.AddBrep(x, attrs('HOST_' + str(i)))
                    elif isinstance(x, rg.Surface):
                        model.Objects.AddSurface(x, attrs('HOST_' + str(i)))
                for i, x in enumerate(Segments or []):
                    x = unwrap(x)
                    if isinstance(x, rg.Line):
                        model.Objects.AddLine(x, attrs('INITIAL_SEGMENT_' + str(i)))
                    elif isinstance(x, rg.Curve):
                        model.Objects.AddCurve(x, attrs('INITIAL_SEGMENT_' + str(i)))
                for i, x in enumerate(Attractors or []):
                    x = unwrap(x)
                    if isinstance(x, rg.Point): x = x.Location
                    if isinstance(x, rg.Point3d): model.Objects.AddPoint(x, attrs('ATTRACTOR_' + str(i)))
                for i, x in enumerate(Guides or []):
                    x = unwrap(x)
                    if isinstance(x, rg.Curve): model.Objects.AddCurve(x, attrs('GUIDE_' + str(i)))
                if not model.Write(os.path.join(runpath, 'geometry.3dm'), 6):
                    raise IOError('Rhino could not write geometry.3dm; partial folder: ' + runpath)
                payload = {'metrics': metrics, 'settings': settings, 'density_report': str(FieldReport), 'utc': stamp,
                           'definition_path': str(document.FilePath), 'limitation': 'Archive the matching GH file with this run. Density assignments travel with initial segments.'}
                with open(os.path.join(runpath, 'run.json'), 'w') as f:
                    json.dump(payload, f, indent=2)
                with open(os.path.join(runpath, 'curve_samples.csv'), 'w') as f:
                    f.write('parameter,x,y,z,curvature,mesh_distance\n')
                    for i, p in enumerate(pts):
                        f.write('{0},{1},{2},{3},{4},{5}\n'.format(ts[i], p.X, p.Y, p.Z, bends[i], deviations[i] if deviations else ''))
                state['path'] = runpath
                summary += '\nSAVED: ' + runpath
            state['report'] = summary
        except Exception as exc:
            state['report'] = 'CHECK / SAVE FAILED: ' + str(exc)
sc.sticky[key] = state
Report = state['report']
SavedPath = state['path']
# ---------- end paused_check_save ----------
last_paused_check = Panel(paused_check_save.Report)
last_saved_run = Panel(paused_check_save.SavedPath)
