# Grasshopper definition OriginalProjectGrasshopperScript.gh (Grasshopper 1.0.8)
# plug-ins: Kangaroo2 Components

# ---- group: Controls
line_complexity_points_on_curve = Slider(1500, range=0..10000)
reset_lines = Button()
animate = BooleanToggle(False)
base_line_curve = Curve(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)

# ---- group: Line to 3D Coversion
pipe = Pipe(Radius=1, Caps=0)  # disabled
demesh = DeconstructMesh(Mesh=pipe)  # -> Vertices, Faces, Colours, Normals; disabled
conmesh = ConstructMesh(Vertices=demesh.Vertices, Faces=demesh.Faces)  # disabled
swatch = ColourSwatch(SwatchColor=RGB(31, 207, 204))  # disabled
preview = CustomPreview(Geometry=conmesh, Material=swatch)  # disabled

# ---- group: Form Builder
number_slider = Slider(300, range=0..1000)
polygon = Polygon(Plane=PlaneXY(0, 0, 0), Radius=Slider(50, range=0..100), Segments=Slider(12, range=0..50), FilletRadius=0)  # -> Polygon, Length
area = Area(Geometry=polygon.Polygon)  # -> Area, Centroid
disc = Discontinuity(Curve=polygon.Polygon, Level=1)  # -> Points, Parameters
dom = ConstructDomain(DomainStart="1", DomainEnd=Slider(2.64, range=0..10))
neg = Negative(Value=Slider(90, range=0..90))
nurbs = NurbsCurve(Vertices=disc.Points, Degree=3, Periodic=False)  # -> Curve, Length, Domain

# ---- group: Form Builder / Shape Builder
lng = ListLength(List=disc.Points)
range = Range(Domain=Domain(0, 1), Steps=expr("x-1", lng))
graph = GraphMapper(range, x0=0, x1=1, y0=0, y1=1, container_name="Bezier", cpx=[0, 0, 1, 1], cpy=[0, 1, 1, 0])
multiplication = Multiplication(A=graph, B=Slider(300, range=0..1000))
Z = UnitZ(Factor=multiplication)

# ---- group: Form Builder (continued)
remap = RemapNumbers(Value=graph, Source=Domain(0, 1), Target=dom)  # -> Mapped, Clipped
scale = Scale(Geometry=disc.Points, Center=area.Centroid, Factor=remap.Mapped)  # -> Geometry, Transform
lng_2 = ListLength(List=scale.Geometry)  # -> expr("x-1", Length)
rotate = Rotate(Geometry=scale.Geometry, Angle=degrees(neg), Plane=area.Centroid)  # -> Geometry, Transform
item = ListItem(List=scale.Geometry, Index=flatten([lng_2, "0"]), Wrap=True)
replace = ReplaceItems(List=rotate.Geometry, Item=item, Indices=flatten(["0", lng_2]), Wrap=False)
move = Move(Geometry=replace, Motion=Z)  # -> Geometry, Transform
nurbs_2 = NurbsCurve(Vertices=move.Geometry, Degree=3, Periodic=False)  # -> Curve, Length, Domain
loft = Loft(
    Curves=flatten([nurbs_2.Curve, nurbs.Curve]),
    Options={Adjust=False, Closed=False, LoftEnds=0, LoftSimp=0, LoftType=0, Rebuild=10, Refit=0.01})

# ---- group: Line Animator
divide = DivideCurve(Curve=base_line_curve, Count=line_complexity_points_on_curve, Kinks=False)  # -> Points, Tangents, Parameters
mesh = MeshBrep(
    Brep=loft,
    Settings={GridMaxCount=0, GridMinCount=16, JaggedSeams=False, MaxEdgeLength=0, MinEdgeLength=0.0001, MinTolerance=0, Refine=True, RefineAngle=0, RelativeTolerance=0.65, SimplePlanes=True, Tolerance=0})
shift = ShiftList(List=divide.Points, Shift=1, Wrap=True)
base_srf_does_not_give_shape = Surface(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)
ln = Line(StartPoint=divide.Points, EndPoint=shift)
map_srf = MapToSurface(Curve=ln, Source=base_srf_does_not_give_shape, Target=loft)
end = EndPoints(Curve=map_srf)  # -> Start, End
line = Line(map_srf)
shift_2 = ShiftList(List=line, Shift=1, Wrap=True)
angle = Angle(LineA=line, LineB=shift_2, RestAngle="0", Strength="1500")
onmesh = OnMesh(Points=end.End, Mesh=mesh, Strength="1000")
length_line = LengthLine(Line=line, Length=Slider(10, range=0..10), Strength="10")
collider = Collider(Objects=line, Radii=Slider(1.1, range=0..10), Strength="100")
bouncysolver = BouncySolver(
    GoalObjects=flatten([onmesh, length_line, collider, angle]),
    Reset=reset_lines,
    Threshold=1e-15,
    Tolerance=0.0001,
    Damping=Slider(1, range=0..1),
    Iterations=10,
    On=animate)  # -> I, V, O
final_curve = NurbsCurve(Vertices=bouncysolver.V, Degree=3, Periodic=invert(False))  # -> Curve, Length, Domain
